# Grasshopper definition Karamba_BESO.gh (Grasshopper 1.0.8)
# plug-ins: Karamba3D, Human, LunchBox

y3 = Slider(10, range=5..15)
y2 = Slider(10, range=5..15)
# GENERATE GEOMETRY
x3 = Slider(0, range=-5..5)
x2 = Slider(10, range=5..15)
u = Slider(5, range=0..12)
v = Slider(9, range=0..12)
xz = XZPlane(Origin=Point(0, 0, 0))
pt = PointOriented(BasePlane=xz, UComponent=x3, VComponent=y3, WComponent=0)
pt_2 = PointOriented(BasePlane=xz, UComponent=x2, VComponent=y2, WComponent=0)
integer = Integer(u)
integer_2 = Integer(v)
srf4pt = _4PointSurface(CornerA="0,0,0", CornerB=pt, CornerC=pt_2, CornerD="10,0,0")
integer_3 = Integer(integer)
braced_grid_2_d_structure = BracedGrid2DStructure(Surface=srf4pt, UDivisions=expr("x-1", integer), VDivisions=expr("x-1", integer_2))  # -> PrimaryLines, BraceLines, StructureNodes
sdivide = DivideSurface(Surface=srf4pt, UCount=expr("x-1", integer), VCount=expr("x-1", integer_2))  # -> Points, Normals, Parameters
subtraction = Subtraction(A=integer_3, B="1")
pt_3 = Point(flatten(sdivide.Points))
list_length = ListLength(List=pt_3)
curve = Curve(braced_grid_2_d_structure.BraceLines)
pt_4 = Point(sdivide.Points)
point = Point(simplify(pt_4))
tree_branch = TreeBranch(Tree=point, Path="0", MaintainPaths=True)
curve_2 = Curve(braced_grid_2_d_structure.PrimaryLines)
integer_4 = Integer(subtraction)
# feed your own point if you like,
# and press True
panel = Panel("2")
integer_5 = Integer(integer_2)
pt_5 = Point()
tree_branch_2 = TreeBranch(Tree=point, Path=integer_4, MaintainPaths=True)
series = Series(Start=0, Step=1, Count=list_length)
curve_3 = Curve(flatten([curve_2, curve]))
integer_division = IntegerDivision(A=integer_5, B=panel)
list_item = ListItem(List=tree_branch, Index=0, Wrap=True)  # -> Item1, Item
point_2 = Point(pt_5)
point_3 = Point(tree_branch_2)
point_4 = Point(point_3)
point_5 = Point(point_3)
list_item_2 = ListItem(List=point_4, Index=integer_division, Wrap=True)
integer_6 = Integer(series)
point_6 = Point(flatten([list_item.Item, list_item.Item1]))
list_item_3 = ListItem(List=point_5, Index=0, Wrap=True)
sphere = Sphere(Base=[point_6, list_item_3], Radius=Slider(0.5, range=0..1))
# DEFINE LOADS
unit_z = UnitZ(Factor=1)
unit_y = UnitY(Factor=1)
radians = Radians(Degrees=Slider(0, range=-180..180))
negative = Negative(Value=unit_z)
rotate = Rotate(Vector=negative, Axis=unit_y, Angle=radians)
multiplication = Multiplication(A=rotate, B="100")
number = Number(Slider(5, range=0..10))
vector = Vector(multiplication)
unit_vector = UnitVector(Vector=vector)
# DEFINE DESIGN
crosec = CrossSectionKaramba3D(
    FamilyNameOfCrossSection="DefaultCroSec",
    Diameter_cm=number,
    WallThickness_cm=expr("x/2", number),
    mode="Circular Hollow")
txt = Text("LC0")
supp = SupportKaramba3D(PosInd=list_item_3, menu=[buttons(on, off, on, off, off, off)])
supp_2 = SupportKaramba3D(PosInd=point_6, menu=[buttons(on, off, on, off, off, off)])
supp_3 = SupportKaramba3D(PosInd=integer_6, menu=[buttons(off, on, off, off, off, off)])
linetobeam = LineToBeamKaramba3D(
    Line=curve_3,
    CrossSection=crosec,
    New=True,
    Remove=True,
    LimitDistance_m=0.005,
    Bending=True,
    SetBucklingLength=True,
    ToPolylineMaxAngle=0.03,
    ToPolylineTolerance=0.01,
    ToPolylineMaxEdgeLength=0.25)  # -> Element, Points, Info
pt_6 = Point(linetobeam.Points)
point_7 = Point(pt_6)
cp = ClosestPoint(Point=point_2, Cloud=point_7)  # -> ClosestPoint, CPIndex, Distance
filter = StreamFilter(Gate=Toggle(False), Stream0=list_item_2, Stream1=cp.ClosestPoint)
point_8 = Point(filter)
point_9 = Point(point_8)
vector_display_ex = VectorDisplayEx(Point=point_9, Vector=unit_vector, Colour=RGB(0, 0, 0), Width=Slider(20, range=0..100))
loads = LoadsKaramba3D(ForceVector=vector, Local=False, PosInd=point_9, LCase=txt, mode="Point")
load = Load(loads)
support = SupportKaramba(flatten([supp_2, supp, supp_3]))
assemble = AssembleModelKaramba3D(Point=pt_3, Elem=linetobeam.Element, Support=support, Load=load, LimitDistance_m=0.005)  # -> Model, Info, Mass_kg, CentreOfGravity, LoadCaseNames
model_karamba3d = ModelKaramba3D(assemble.Model)
# INITIAL ANALYSIS
# Sanity Check (can be turned off)
analyze = AnalyzeKaramba3D(Model=model_karamba3d)  # -> CalculatedModel, MaximumDisplacement_cm, ResultingForceOfGravity_kN, ElasticEnergyChange_kNm
number_2 = Number(assemble.Mass_kg)
panel_2 = Panel(analyze.MaximumDisplacement_cm)
model_karamba3d_2 = ModelKaramba3D(analyze.CalculatedModel)
number_slider = Slider(30, range=0..100)
txt_2 = Text(txt)
besobeam = BESOForBeamsKaramba3D(
    Model=assemble.Model,
    LoadCases=txt_2,
    TargetMassRatio=Slider(0.434, range=0..1),
    NumberOfChangeIterations=number_slider,
    NumberOfConvergenceIterations=number_slider,
    WeightingFactorForTension=1,
    WeightingFactorForCompression=1,
    WeightingFactorForShear=0,
    WeightingFactorForMoments=0,
    BESOFactor=0,
    MinimumDistanceBetweenChangingElements=0,
    RelativeWeightLimit=0)  # -> MaximumDisplacement_cm, OptimizedModel, HistoryOfTheBESO, ElementIsActive, DistributionOfWeights
modelview = ModelViewKaramba3D(Model=besobeam.OptimizedModel, ResultFactors=1, ResultCase=-1)  # -> Model, DeformedMesh, DeformedAxes, DeformedModel
beamview = BeamViewKaramba3D(Model=modelview.Model)  # -> Model, MeshesOfRenderedBeams, DeformedBeamAxes, LegendColours, LegendTags
curve_4 = Curve(modelview.DeformedAxes)
custom_preview_lineweights = CustomPreviewLineweights(Geometry=curve_4, Shader=ColourSwatch(SwatchColor=RGB(0, 0, 0)), Thickness=Slider(5, range=0..10), Absolute=False)
model_karamba3d_3 = ModelKaramba3D(modelview.Model)
utilization = UtilizationOfElementsKaramba3D(
    AnalysedModel=model_karamba3d_3,
    NumberOfSamplePoints=3,
    ElasticDesign=True,
    GammaM0=1,
    GammaM1=1.1,
    SwayFrame=True,
    WithDetails=False,
    mode="Beams")  # -> Model, Utilization, SigMax_kN_cm², SigMin_kN_cm², TauMax_kN_cm², UtilN, UtilVy, UtilVz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
num = Number(flatten(utilization.Utilization))
list_length_2 = ListLength(List=num)
series_2 = Series(Start=0, Step=1, Count=list_length_2)
sort_list = SortList(Keys=num, ValuesValuesA=series_2)  # -> Keys, ValuesValuesA
list_item_4 = ListItem(List=sort_list.Keys, Index=0, Wrap=True)  # -> Item1, Item
# Always Make Sure No Elements Are Failing!!
panel_3 = Panel(sort_list.ValuesValuesA)
number_3 = Number(list_item_4.Item)
number_4 = Number(list_item_4.Item1)
larger_than = LargerThan(FirstNumber=number_4, SecondNumber="1")  # -> LargerThan, OrEqualTo
panel_4 = Panel(sort_list.Keys)
max_utilisation = Panel(number_4)
failing = Panel(larger_than.LargerThan)
min_utilisation = Panel(number_3)
