# Grasshopper definition PatternMorph.gh (Grasshopper 1.0.8)
# plug-ins: Karamba3D, RhinoCodePluginGH, Human, Weaverbird, Kangaroo2 Components

sampling_mode = BooleanToggle(False)

d2 = Slider(0.529, range=0..1)
d1 = Slider(0.404, range=0..1)
num_y = Slider(6, range=2..14)

reset = Button()
random = Random(Range=Domain(0, 1), Number=Slider(10, range=0..10), Seed=Slider(14, range=0..10000))
data = Data(sampling_mode)
data_2 = Data(Toggle(True))
data_3 = Data(Toggle(True))
data_4 = Data(reset)
panel = Panel(random)
item = ListItem(List=panel, Index=0, Wrap=True)  # -> Item, Item1, Item2, Item3, Item4, Item5, Item6, Item7, Item8, Item9
G = Gate(data)
num = Number(num_y)
G_2 = Gate(data)
num_2 = Number(item.Item2)
G_3 = Gate(data)
num_3 = Number(item.Item1)
num_4 = Number(d2)
num_5 = Number(d1)
G_4 = Gate(data)
G_5 = Gate(data)
num_6 = Number(Slider(1.3, range=0..10))
num_7 = Number(item.Item4)
G_6 = Gate(data)
num_8 = Number(item.Item5)
num_9 = Number(Slider(0.287, range=0..1))
G_7 = Gate(data)
num_10 = Number(Slider(0.425, range=0..1))
num_11 = Number(item.Item6)
num_12 = Number(Slider(0.608, range=0..1))
G_8 = Gate(data)
num_13 = Number(item.Item8)
num_14 = Number(Slider(0.708, range=0..1))
G_9 = Gate(data)
num_15 = Number(item.Item7)
num_16 = Number(Slider(0.399, range=0..1))
G_10 = Gate(data)
num_17 = Number(item.Item9)
num_18 = Number(Slider(0.532, range=0..1))
filter = StreamFilter(Gate=G_2, Stream0=num_4, Stream1=num_2)
filter_2 = StreamFilter(Gate=G_3, Stream0=num_5, Stream1=num_3)
multiplication = Multiplication(A=item.Item3, B="10")
num_19 = Number(multiplication)
filter_3 = StreamFilter(Gate=G_4, Stream0=num_6, Stream1=num_19)
filter_4 = StreamFilter(Gate=G_5, Stream0=num_9, Stream1=num_7)
filter_5 = StreamFilter(Gate=G_6, Stream0=num_10, Stream1=num_8)
filter_6 = StreamFilter(Gate=G_7, Stream0=num_12, Stream1=num_11)
multiplication_2 = Multiplication(A=item.Item, B="13")
filter_7 = StreamFilter(Gate=G_8, Stream0=num_14, Stream1=num_13)
filter_8 = StreamFilter(Gate=G_9, Stream0=num_16, Stream1=num_15)
filter_9 = StreamFilter(Gate=G_10, Stream0=num_18, Stream1=num_17)
round = Round(Number=multiplication_2)  # -> Nearest, Floor, Ceiling
addition = Addition(A=round.Floor, B="2")
num_20 = Number(addition)
filter_10 = StreamFilter(Gate=G, Stream0=num, Stream1=num_20)
integer = Integer(filter_10)
panel_2 = Panel(integer)
merge = Merge(
    Data1=filter_10,
    Data2=filter_2,
    Data3=filter,
    Data4=filter_3,
    Data5=filter_4,
    Data6=filter_5,
    Data7=filter_6,
    Data8=filter_8,
    Data9=filter_7,
    Data10=filter_9)
num_21 = Number(merge)
crv = Curve(<curve referenced from the Rhino model>)
data_5 = Data(Slider(2, range=0..10))
scale = Scale(Geometry=crv, Center=Point(0, 0, 0), Factor=Slider(1, range=0..1))  # -> Geometry, Transform
srf = Surface(reparameterize(scale.Geometry))
data_6 = Data(data_5)
sdivide = DivideSurface(Surface=srf, UCount=data_6, VCount=data_6)  # -> Points, Normals, simplify(Parameters)
data_7 = Data(filter_3)
evalsrf = EvaluateSurface(Surface=srf, Point=sdivide.Parameters)  # -> Point, Normal, Frame
Z = UnitZ(Factor=data_7)
pt = Point(evalsrf.Point)
data_8 = Data(Z)
pattern_type_toggle = BooleanToggle(False)
data_9 = Data(filter_2)
data_10 = Data(filter)
num_y_2 = Integer(panel_2)

pt_2 = Point(flatten(pt))
data_11 = Data(data_6)
data_12 = Data(data_8)
panel_3 = Panel("""0
2
6
8""")
panel_4 = Panel("""1
3
5
7""")
data_13 = Data(filter_4)
data_14 = Data(filter_5)
data_15 = Data(filter_6)
item_2 = ListItem(List=pt_2, Index=panel_3, Wrap=True)
item_3 = ListItem(List=pt_2, Index=panel_4, Wrap=True)
item_4 = ListItem(List=pt_2, Index="4", Wrap=True)
pt_3 = Point(item_4)
pt_4 = Point(item_2)
pt_5 = Point(item_3)
multiplication_3 = Multiplication(A=data_12, B=data_13)
multiplication_4 = Multiplication(A=data_12, B=data_14)
multiplication_5 = Multiplication(A=data_12, B=data_15)
data_16 = Data(multiplication_3)
data_17 = Data(multiplication_4)
data_18 = Data(multiplication_5)
move = Move(Geometry=pt_4, Motion=data_16)  # -> Geometry, Transform
move_2 = Move(Geometry=pt_5, Motion=data_17)  # -> Geometry, Transform
move_3 = Move(Geometry=pt_3, Motion=data_18)  # -> Geometry, Transform
merge_2 = Merge(Data1=panel_3, Data2=panel_4, Data3="4")
merge_3 = Merge(Data1=move.Geometry, Data2=move_2.Geometry, Data3=move_3.Geometry)
data_19 = Data(merge_2)
pt_6 = Point(pt_2)
pt_7 = Point(merge_3)
pt_8 = Point(pt_7)
replace = ReplaceItems(List=pt_6, Item=pt_8, Indices=data_19, Wrap=False)
pt_9 = Point(replace)
pt_10 = Point(pt_9)
srfgrid = SurfaceFromPoints(Points=pt_10, UCount=expr("x+1", data_11), Interpolate=False)
srf_2 = Surface(srfgrid)

pt_11 = Point(flatten(pt))
data_20 = Data(data_6)
panel_5 = Panel("""0
2
6
8""")
panel_6 = Panel("""1
3
5
7""")
data_21 = Data(data_8)
data_22 = Data(filter_9)
data_23 = Data(filter_8)
item_5 = ListItem(List=pt_11, Index=panel_5, Wrap=True)
item_6 = ListItem(List=pt_11, Index=panel_6, Wrap=True)
data_24 = Data(filter_7)
item_7 = ListItem(List=pt_11, Index="4", Wrap=True)
pt_12 = Point(item_7)
pt_13 = Point(item_5)
pt_14 = Point(item_6)
multiplication_6 = Multiplication(A=data_21, B=data_23)
multiplication_7 = Multiplication(A=data_21, B=data_24)
multiplication_8 = Multiplication(A=data_21, B=data_22)
data_25 = Data(multiplication_6)
data_26 = Data(multiplication_7)
data_27 = Data(multiplication_8)
move_4 = Move(Geometry=pt_13, Motion=data_25)  # -> Geometry, Transform
move_5 = Move(Geometry=pt_14, Motion=data_26)  # -> Geometry, Transform
merge_4 = Merge(Data1=panel_5, Data2=panel_6, Data3="4")
move_6 = Move(Geometry=pt_12, Motion=data_27)  # -> Geometry, Transform
merge_5 = Merge(Data1=move_4.Geometry, Data2=move_5.Geometry, Data3=move_6.Geometry)
data_28 = Data(merge_4)
pt_15 = Point(pt_11)
pt_16 = Point(merge_5)
pt_17 = Point(pt_16)
replace_2 = ReplaceItems(List=pt_15, Item=pt_17, Indices=data_28, Wrap=False)
pt_18 = Point(replace_2)
pt_19 = Point(pt_18)
srfgrid_2 = SurfaceFromPoints(Points=pt_19, UCount=expr("x+1", data_20), Interpolate=False)
srf_3 = Surface(srfgrid_2)

boolean = Boolean(pattern_type_toggle)
num_y_3 = Integer(num_y_2)
srf_4 = Surface(srf_3)
srf_5 = Surface(srf_2)
srf_6 = Surface(srf_5)
srf_7 = Surface(srf_4)
crv_2 = Curve(<curve referenced from the Rhino model>)
number_slider = Slider(0.006, range=0..0.01)
Z_2 = UnitZ(Factor=Slider(0.3, range=0..1))
rev = Reverse(Vector=Z_2)
loads = LoadsKaramba3D(Vector=Vector(0, 0, -1), LCase="LC0", mode="Gravity")
panel_7 = Panel("""1
2
3
4
5
6
7
8
9
10""")
num_22 = Number(num_21)
image_file_name_prefix = Panel("test_save")
csv_file_name = Panel("data_log.csv")
bool = Boolean(data_2)
# Path
folder_path = Panel("D:\Dropbox\HKU_202425S1_ARCH7378\Scripts\B_Helpers\New folder")
# Create header row of csv spreadsheet,
# containing names of the columns
panel_8 = Panel("image_path")
data_29 = Data(data_4)
data_30 = Data(num_22)
bool_2 = Boolean(bool)
merge_6 = Merge(Data1=panel_7, Data2="max_disp", Data3=panel_8)
txt = Text(folder_path)
txt_2 = Text(txt)
txt_3 = Text(image_file_name_prefix)
txt_4 = Text(txt)
txt_5 = Text(csv_file_name)
concat = Concatenate(FragmentA=txt_4, FragmentB="/", FragmentC=txt_5)
concat_2 = Concatenate(FragmentA=txt_2, FragmentB="/", FragmentC=txt_3)
txt_6 = Text(concat)
txt_7 = Text(txt_6)
txt_8 = Text(merge_6)
bool_3 = Boolean(data_3)
data_31 = Data(data_4)
txt_9 = Text(concat_2)
# Screenshot Saver
txt_10 = Text(txt_9)
panel_9 = Panel(txt_6)

# ----
# File reader
panel_10 = Panel(csv_file_name)
python_3_script = Python3Script(filename=panel_10)  # -> out, filepath
# ---------- python_3_script: Python ----------
import os

_filepath = ghenv.Component.OnPingDocument().FilePath
path = os.path.dirname(_filepath)

filepath = os.path.join(path, filename)
# ---------- end python_3_script ----------
panel_11 = Panel(python_3_script.filepath)
file_path = FilePath(panel_11)
read_file = ReadFile(File=file_path, PerLineParse=True)
cull_index = CullIndex(List=read_file, Indices="0", Wrap=True)
text_split = TextSplit(Text=cull_index, Separators=",")  # -> simplify(Result)
number = Number(text_split)
panel_12 = Panel(number)

division = Division(A="3.5184", B=num_y_3)
division_2 = Division(A="2.1155", B=num_y_3)
division_3 = Division(A="1.9238", B=num_y_3)
division_4 = Division(A="1.2086", B=num_y_3)
construct_domain = ConstructDomain(DomainStart="0", DomainEnd=division_3)
construct_domain_2 = ConstructDomain(DomainStart="0", DomainEnd=division_4)
construct_domain_3 = ConstructDomain(DomainStart="0", DomainEnd=division)
construct_domain_4 = ConstructDomain(DomainStart="0", DomainEnd=division_2)
remap_numbers = RemapNumbers(Value=data_9, Source=Domain(0, 1), Target=construct_domain_3)  # -> Mapped, Clipped
remap_numbers_2 = RemapNumbers(Value=data_10, Source=Domain(0, 1), Target=construct_domain_4)  # -> Mapped, Clipped
remap_numbers_3 = RemapNumbers(Value=data_9, Source=Domain(0, 1), Target=construct_domain)  # -> Mapped, Clipped
remap_numbers_4 = RemapNumbers(Value=data_10, Source=Domain(0, 1), Target=construct_domain_2)  # -> Mapped, Clipped
d1_square = Panel(remap_numbers.Mapped)
d2_square = Panel(remap_numbers_2.Mapped)
d1_rectangle = Panel(remap_numbers_3.Mapped)
d2_rectangle = Panel(remap_numbers_4.Mapped)
d2_2 = Number([d2_square, d2_rectangle])
d1_2 = Number([d1_square, d1_rectangle])

construct_domain_5 = ConstructDomain(DomainStart="0", DomainEnd=division_2)
construct_domain_6 = ConstructDomain(DomainStart="0", DomainEnd=division)

num_x_3_num_y = Panel("3")
num_x = Panel(num_y_2)
expression = Expression(x=boolean, y=boolean, Expression="if(x = true, 1, 0)")
multiplication_9 = Multiplication(A=num_x_3_num_y, B=num_y_2)

num_x_2 = Integer([num_x, multiplication_9])

list_item = ListItem(List=num_x_2, Index=expression, Wrap=True)
integer_2 = Integer(list_item)

list_item_2 = ListItem(List=d1_2, Index=expression, Wrap=True)
list_item_3 = ListItem(List=d2_2, Index=expression, Wrap=True)
d1_3 = Number(list_item_2)
d2_3 = Number(list_item_3)

const_area = Panel("100")
multiplication_10 = Multiplication(A=integer_2, B=num_y_3)
division_5 = Division(A=const_area, B=multiplication_10)
square_root = SquareRoot(Value=division_5)

sqgrid = Square(Plane=PlaneXY(0, 0, 0), Size=square_root, ExtentX=list_item, ExtentY=num_y_3)  # -> Cells, Points
divide = DivideCurve(Curve=sqgrid.Cells, Count=12, Kinks=False)  # -> Points, Tangents, Parameters
item_8 = ListItem(List=divide.Points, Index=[1, 2, 4, 5, 7, 8, 10, 11], Wrap=False)
item_9 = ListItem(List=divide.Points, Index=[4, 7, 10, 1], Wrap=False)
item_10 = ListItem(List=divide.Points, Index=[2, 5, 8, 11], Wrap=False)
pline = PolyLine(Vertices=item_8, Closed=True)  # -> simplify(Polyline)
ln = Line(StartPoint=item_10, EndPoint=item_9)
join = JoinCurves(Curves=flatten(ln), Preserve=False)  # -> flatten(Curves)
explode = Explode(Curve=pline, Recursive=True)  # -> Segments, Vertices
cls = Closed(Curve=join)  # -> Closed, Periodic
crv_3 = Curve(pline)
cull = CullPattern(List=join, CullPattern=cls.Closed)
explode_2 = Explode(Curve=cull, Recursive=True)  # -> Segments, Vertices
eval = EvaluateCurve(Curve=reparameterize(explode.Segments), Parameter=0.5)  # -> simplify(Point), Tangent, Angle

crv_4 = Curve(simplify(graft(cull)))
crv_5 = Curve(simplify(crv_3))
crv_6 = Curve(simplify(graft(pline)))
explode_3 = Explode(Curve=crv_6, Recursive=True)  # -> simplify(Segments), simplify(Vertices)
curvepoint = PointOnCurve(explode_3.Segments, parameter=0.5)
weave = Weave(Pattern=[0, 1], Stream0=explode_3.Vertices, Stream1=curvepoint, NullGaps=False)
pline_2 = PolyLine(Vertices=weave, Closed=False)
crv_7 = Curve(pline_2)

crv_8 = Curve(flatten(crv_7))
explode_4 = Explode(Curve=crv_8, Recursive=True)  # -> Segments, Vertices
pt_20 = Point(flatten(explode_4.Vertices))
crv_9 = Curve(flatten(explode_4.Segments))

crv_10 = Curve(crv_5)

pt_21 = Point(flatten(pt_20))
crv_11 = Curve(flatten(crv_9))
hull = ConvexHull(Points=pt_21, Plane=PlaneXY(0, 0, 0))  # -> Hull, HullZ, Indices
crv_12 = Curve(reparameterize(hull.Hull))

crv_13 = Curve(crv_12)
crv_cp = CurveClosestPoint(Point=pt_21, Curve=crv_13)  # -> Point, Parameter, Distance
pt_22 = Point(crv_cp.Point)
data_32 = Data(crv_cp.Distance)
data_33 = Data(crv_cp.Parameter)
smaller = SmallerThan(FirstNumber=data_32, SecondNumber="0.001")  # -> SmallerThan, OrEqualTo
dispatch = Dispatch(List=pt_22, DispatchPattern=smaller.SmallerThan)  # -> ListA, ListB
dispatch_2 = Dispatch(List=data_33, DispatchPattern=smaller.SmallerThan)  # -> ListA, ListB
pt_23 = Point(dispatch.ListA)
data_34 = Data(dispatch_2.ListA)

crv_14 = Curve(crv_9)
curvepoint_2 = PointOnCurve(crv_14, parameter=0.5)
crv_cp_2 = CurveClosestPoint(Point=curvepoint_2, Curve=crv_12)  # -> Point, Parameter, Distance

data_35 = Data(crv_14)
data_36 = Data(crv_cp_2.Distance)
smaller_2 = SmallerThan(FirstNumber=data_36, SecondNumber="0.001")  # -> SmallerThan, OrEqualTo
dispatch_3 = Dispatch(List=data_35, DispatchPattern=smaller_2.SmallerThan)  # -> ListA, ListB
data_37 = Data(dispatch_3.ListB)

crv_15 = Curve(crv_12)
shatter = Shatter(Curve=crv_15, Parameters=data_34)
crv_16 = Curve(shatter)

crv_17 = Curve(crv_16)
pt_24 = Point(pt_23)
crv_18 = Curve(crv_16)
crv_19 = Curve(crv_18)
crv_20 = Curve(crv_19)
join_2 = JoinCurves(Curves=crv_20, Preserve=False)
simplify = SimplifyCurve(Curve=join_2)  # -> Curve, Simplified
explode_5 = Explode(Curve=simplify.Curve, Recursive=True)  # -> Segments, Vertices
crv_21 = Curve(flatten(simplify.Curve))
crv_22 = Curve(flatten(explode_5.Segments))
pt_25 = Point(flatten(explode_5.Vertices))
crv_23 = Curve(crv_21)
crv_24 = Curve(crv_23)

crv_25 = Curve(crv_5)
area = Area(Geometry=crv_25)  # -> Area, Centroid
data_38 = Data("100")
Z_3 = UnitZ(Factor=data_38)
pt_26 = Point(area.Centroid)
move_7 = Move(Geometry=pt_26, Motion=Z_3)  # -> Geometry, Transform
pt_27 = Point(move_7.Geometry)
geo = Geometry(srf_7)
project = ProjectPoint(Point=pt_27, Direction=Vector(0, 0, -1), Geometry=geo)  # -> Point, Index
pt_28 = Point(project.Point)
pdecon = Deconstruct(Point=pt_28)  # -> XComponent, YComponent, ZComponent
data_39 = Data(pdecon.ZComponent)

data_40 = Data(data_39)
min = Minimum(A=data_40, B="1")
data_41 = Data(min)

data_42 = Data(data_41)

remap_numbers_5 = RemapNumbers(Value=data_42, Source=Domain(0, 1), Target=construct_domain_6)  # -> Mapped, Clipped
data_43 = Data(remap_numbers_5.Mapped)

crv_26 = Curve(crv_4)
area_2 = Area(Geometry=crv_26)  # -> Area, Centroid
data_44 = Data("100")
Z_4 = UnitZ(Factor=data_44)
pt_29 = Point(area_2.Centroid)
move_8 = Move(Geometry=pt_29, Motion=Z_4)  # -> Geometry, Transform
pt_30 = Point(move_8.Geometry)
geo_2 = Geometry(srf_6)
project_2 = ProjectPoint(Point=pt_30, Direction=Vector(0, 0, -1), Geometry=geo_2)  # -> Point, Index
pt_31 = Point(project_2.Point)
pdecon_2 = Deconstruct(Point=pt_31)  # -> XComponent, YComponent, ZComponent
data_45 = Data(pdecon_2.ZComponent)

data_46 = Data(data_45)
min_2 = Minimum(A=data_46, B="1")
data_47 = Data(min_2)

data_48 = Data(data_47)

remap_numbers_6 = RemapNumbers(Value=data_48, Source=Domain(0, 1), Target=construct_domain_5)  # -> Mapped, Clipped
data_49 = Data(remap_numbers_6.Mapped)

crv_27 = Curve(crv_4)
crv_28 = Curve(crv_10)
data_50 = Data(data_43)
data_51 = Data(data_49)
crv_29 = Curve(crv_27)
offset = Offset(Curve=crv_28, Distance=expr("-x", data_50), Plane=PlaneXY(0, 0, 0), Corners=1)
offset_2 = Offset(Curve=simplify(crv_29), Distance=simplify(data_51), Plane=PlaneXY(0, 0, 0), Corners=1)  # -> simplify(Curve)
eval_2 = EvaluateCurve(Curve=reparameterize(explode_2.Segments), Parameter=0.5)  # -> simplify(Point), Tangent, Angle
explode_6 = Explode(Curve=offset, Recursive=True)  # -> Segments, simplify(Vertices)
explode_7 = Explode(Curve=offset_2, Recursive=True)  # -> Segments, simplify(Vertices)
weave_2 = Weave(Pattern=[0, 1], Stream0=explode_6.Vertices, Stream1=eval.Point, NullGaps=False)
weave_3 = Weave(Pattern=[0, 1], Stream0=explode_7.Vertices, Stream1=eval_2.Point, NullGaps=False)
rdpoints = RemoveDuplicatePointsKaramba3D(Point=explode_7.Vertices, LimitDistance=0.005)  # -> OutPoint, Info, Indexes
rdpoints_2 = RemoveDuplicatePointsKaramba3D(Point=weave_3, LimitDistance=0.005)  # -> OutPoint, Info, Indexes
rdpoints_3 = RemoveDuplicatePointsKaramba3D(Point=explode_6.Vertices, LimitDistance=0.005)  # -> OutPoint, Info, Indexes
rdpoints_4 = RemoveDuplicatePointsKaramba3D(Point=weave_2, LimitDistance=0.005)  # -> OutPoint, Info, Indexes
pline_3 = PolyLine(Vertices=rdpoints_2.OutPoint, Closed=True)
pline_4 = PolyLine(Vertices=rdpoints_4.OutPoint, Closed=True)
polyline = PolyLine(Vertices=rdpoints.OutPoint, Closed=True)
polyline_2 = PolyLine(Vertices=rdpoints_3.OutPoint, Closed=True)
simplify_2 = SimplifyCurve(Curve=polyline)  # -> Curve, Simplified
simplify_3 = SimplifyCurve(Curve=pline_3)  # -> Curve, Simplified
simplify_4 = SimplifyCurve(Curve=pline_4)  # -> Curve, Simplified
simplify_5 = SimplifyCurve(Curve=polyline_2)  # -> Curve, Simplified
crv_30 = Curve([simplify_5.Curve, simplify_4.Curve, simplify_3.Curve, simplify_2.Curve])
explode_8 = Explode(Curve=crv_30, Recursive=True)  # -> Segments, Vertices

crv_31 = Curve(flatten(explode_8.Segments))

crv_32 = Curve(data_37)
crv_33 = Curve(crv_31)
merge_7 = Merge(Data1=crv_17, Data2=crv_32, Data3=crv_33)  # -> flatten(Result)
rdlines = RemoveDuplicateLinesKaramba3D(Line=merge_7, LimitDistance=0.005)  # -> OutLine, Info, Indexes
crv_34 = Curve(rdlines.OutLine)

crv_35 = Curve(data_37)
crv_36 = Curve(crv_31)
merge_8 = Merge(Data2=crv_35, Data3=crv_36)  # -> flatten(Result)
rdlines_2 = RemoveDuplicateLinesKaramba3D(Line=merge_8, LimitDistance=0.005)  # -> OutLine, Info, Indexes
crv_37 = Curve(rdlines_2.OutLine)

crv_38 = Curve(crv_37)
crv_39 = Curve(crv_38)
end = EndPoints(Curve=crv_39)  # -> flatten(Start), flatten(End)
cset = CreateSet(List=flatten([end.Start, end.End]))  # -> Set, Map
pt_32 = Point(cset.Set)
pt_33 = Point(pt_32)
crv_40 = Curve(crv_39)
crv_41 = Curve(flatten([crv_40, crv_23, crv_2]))
crv_42 = Curve(crv_40)
pt_34 = Point(pt_33)
previewlw = CustomPreviewLineweights(Geometry=crv_41, Shader=ColourSwatch(SwatchColor=RGB(0, 0, 0)), Thickness=Slider(4, range=0..10), Absolute=False)

# ---- group: structural analysis
# STRUCTURAL ANALYSIS
explode_9 = Explode(Curve=crv_24, Recursive=True)  # -> flatten(Segments), Vertices
explode_10 = Explode(Curve=crv_2, Recursive=True)  # -> flatten(Segments), Vertices
llinter = LineLineIntersectionKaramba3D(IntersectingLines=flatten(crv_42), LinesToIntersect=graft(explode_9.Segments), LimitDistance_m=0.005)  # -> InterSecPoints, LineSubSegments
llinter_2 = LineLineIntersectionKaramba3D(IntersectingLines=flatten(crv_42), LinesToIntersect=graft(explode_10.Segments), LimitDistance_m=0.005)  # -> InterSecPoints, LineSubSegments
crv_43 = Curve(flatten(llinter.LineSubSegments))
line = Line(flatten(llinter.LineSubSegments))
null = NullItem(Item=crv_43)  # -> NullFlags, InvalidFlags, Description
end_2 = EndPoints(Curve=crv_43)  # -> Start, End
crv_44 = Curve(flatten(llinter_2.LineSubSegments))
line_2 = Line(flatten(llinter_2.LineSubSegments))
dispatch_4 = Dispatch(List=crv_43, DispatchPattern=null.InvalidFlags)  # -> ListA, ListB
null_2 = NullItem(Item=crv_44)  # -> NullFlags, InvalidFlags, Description
end_3 = EndPoints(Curve=crv_44)  # -> Start, End
dispatch_5 = Dispatch(List=crv_44, DispatchPattern=null_2.InvalidFlags)  # -> ListA, ListB
crv_45 = Curve([dispatch_5.ListB, dispatch_4.ListB])
dupln = RemoveDuplicateLines(Lines=crv_45, Tolerance=0.01)
merge_9 = Merge(Data1=crv_42, Data2=dupln)  # -> flatten(Result)
crv_46 = Curve(merge_9)
material_consumption = Panel("5600")
end_4 = EndPoints(Curve=line_2)  # -> Start, End
len = Length(Curve=crv_46)
division_6 = Division(A=material_consumption, B="7350")
ma = MassAddition(Input=len)  # -> Result, PartialResults
division_7 = Division(A=division_6, B=ma.Result)
panel_13 = Panel("100")

# ----
pt_35 = Point([end_4.End, end_4.Start])
wbweave = WeaverbirdsMeshFromLinesWeaveBack(Lines=crv_46, MaximumValence=Slider(10, range=0..10))
duppt = RemoveDuplicatePts(Points=pt_35, Tolerance=0.01)
expression_2 = Expression(x=division_7, y=number_slider, Expression="(x+4*y²)/4/y")
supp = SupportKaramba3D(PosInd=duppt, menu=[buttons(on, on, on, off, off, off)])
loads_2 = LoadsKaramba3D(Vector=rev, Mesh=wbweave, LCase="LC0", mode="MeshLoad -Const.", menu=[buttons(on, off, off), buttons(on, on)])
multiplication_11 = Multiplication(A=number_slider, B=panel_13)
load = LoadKaramba3D([loads, loads_2])

# ---- group: structural analysis (continued)
multiplication_12 = Multiplication(A=expression_2, B=panel_13)
num_23 = Number(multiplication_12)
support = Support(supp)
crosec = CrossSectionKaramba3D(
    FamilyNameOfCrossSection="DefaultCroSec",
    Height_cm=num_23,
    UpperFlangeWidth_cm=num_23,
    LowerFlangeWidth_cm=num_23,
    UpperFlangeThickness_cm=multiplication_11,
    LowerFlangeThickness_cm=multiplication_11,
    SidewallsThickness_cm=multiplication_11,
    FilletRadius_cm=0.6,
    mode="Box")
lineelem = CreateLinearElementKaramba3D(
    Line=crv_46,
    CrossSection=crosec,
    LimitDistance_m=0.005,
    BucklingLengthY_m=-1,
    BucklingLengthZ_m=-1,
    BucklingLengthLT_m=-1,
    Bending=True,
    ToPolylineMaxAngle=0.03,
    ToPolylineTolerance=0.01,
    ToPolylineMaxEdgeLength=0.25,
    New=True,
    Remove=True,
    mode="LineToBeam")  # -> Element, Points, Info
elem = Elem(lineelem.Element)
support_2 = Support(flatten(support))
load_2 = LoadKaramba3D(flatten(load))
elem_2 = Elem(flatten(elem))
assemble = AssembleModelKaramba3D(Elem=elem_2, Support=support_2, Load=load_2, LimitDistance_m=0.005)  # -> Model, Info, Mass_kg, CentreOfGravity, LoadCaseNames
model = Model(assemble.Model)
analyse = AnalyseKaramba3D(Model=model)  # -> AnalysedModel, MaximumDisplacement_cm, ResultingForce_kN, ChangeOfElasticEnergy_kNm
model_2 = Model(analyse.AnalysedModel)
num_24 = Number(analyse.MaximumDisplacement_cm)
modelview = ModelViewKaramba3D(Model=analyse.AnalysedModel)  # -> Model, DeformedMesh, DeformedAxes, DeformedModel, MaximumDeformation
b_forces = BeamForcesKaramba3D(AnalysedModel=model_2, Ts=[0, 1])  # -> Model, NormalForce_kN, ShearForceVz_kN, ShearForceVy_kN, TorsionalMomentMt_kNm, flatten(BendingMomentMy_kNm), flatten(BendingMomentMz_kNm), LoadCaseIndex
beamview = BeamViewKaramba3D(Model=modelview.Model)  # -> Model, MeshesOfRenderedBeams, DeformedBeamAxes, LegendColours, LegendTags
legend = Legend(Colour=beamview.LegendColours, Tags=beamview.LegendTags, LegendType=1)
panel_14 = Panel(b_forces.BendingMomentMz_kNm)
model_3 = ModelKaramba3D(beamview.Model)

# ----
data_52 = Data(flatten(model_3))
num_25 = Number(num_24)
data_53 = Data(num_25)
item_11 = ListItem(List=data_52, Index=0, Wrap=True)
c_name_iterator = CSharpScript(port=item_11, T=bool_2, R=data_29, P=txt_10)  # -> out, A; inputs T: Boolean, R: Boolean
# ---------- c_name_iterator: C# ----------
    if(T)
    {
      n++;
    }
    if(R)
    {
      n = 0;
    }
    A = P + "_" + n + ".jpg";
# ---------- c_name_iterator: C# additional code ----------
  public int n;
# ---------- end c_name_iterator ----------
txt_11 = Text(c_name_iterator.A)
# Merge data
# CSV File Streamer
data_54 = Data(txt_11)
merge_10 = Merge(Data1=flatten(data_30), Data2=flatten(data_53), Data3=flatten(data_54))
data_55 = Data(flatten(merge_10))
c_vp_to_img = CSharpScript(T=bool_2, P=txt_11)  # inputs T: Boolean, P: String
# ---------- c_vp_to_img: C# ----------
    if(T)
    {
      var file_name = "";
      if (P != "")
      {
        file_name = P;
        var bitmap = RhinoDoc.ActiveDoc.Views.ActiveView.CaptureToBitmap(false, false, false);
        //Clipboard.SetImage(bitmap);
        bitmap.Save(file_name);
      }
    }
# ---------- end c_vp_to_img ----------
full_saved_image_path = Panel(txt_11)
panel_15 = Panel(data_55)
data_56 = Data(data_55)
ghpython_script = GhPythonScript(filepath=txt_7, head=txt_8, data=data_56, write=bool_3, reset=data_31)  # -> out, a; inputs head: list, data: list
# ---------- ghpython_script: Python ----------
__author__ = "tamk"
__version__ = "2024.04.04"

import rhinoscriptsyntax as rs
from scriptcontext import sticky
import os
import sys


if reset:
    _ = sticky.pop('filestream', {})
    
fs = sticky.setdefault('filestream', None)

if not fs and filepath and write:
    fs = sticky['filestream'] = open(filepath, 'w')
    if head:
        fs.write(','.join(str(_h) for _h in head) + '\n')
    
if fs and write:
    fs.write(','.join(str(_x) for _x in data) + '\n')
    fs.flush()

if fs and not write:
    fs.close()
    fs = sticky['filestream'] = None
# ---------- end ghpython_script ----------
